# Grasshopper definition workshop.gh (Grasshopper 1.0.8)
# plug-ins: LadybugGrasshopper

samples = LBSamples()

# ---- group: Chage Glazing Ratio, Orientation, and Program
number_slider = Slider(0.9, range=0.1..0.9)
number_slider_2 = Slider(4, range=0..8, expression="x * 45")

# ----
panel = Panel("2019::LargeOffice::OpenOffice")

# ----
# Create Honeybee Room
panel_2 = Panel("outdoors")
geo = Geometry(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)
geo_2 = Geometry([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])
face = HBFace(geo=geo, bc=panel_2)  # -> report, faces; plug-in component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
face_2 = HBFace(geo=geo_2, bc="adiabatic")  # -> report, faces; plug-in component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
aperturesbyratio = HBAperturesByRatio(hb_objs=flatten(face.faces), ratio=number_slider, subdivide=Toggle(False))  # -> report, hb_objs; plug-in component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
room = HBRoom(
    faces=flatten([face_2.faces, aperturesbyratio.hb_objs]),
    name="Office Shoe Box",
    constr_set="2004::ClimateZone3::SteelFramed",
    program=panel,
    conditioned=True)  # -> report, room; plug-in component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
rotate = HBRotate(hb_objs=flatten(room.room), angle=number_slider_2)  # -> hb_objs; plug-in component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

simoutput = HBSimulationOutput(comfort_metrics=Toggle(True))  # -> report, sim_output; plug-in component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
simpar = HBSimulationParameter(output=simoutput.sim_output, timestep=6)  # -> sim_par; plug-in component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

# ----
# Download EPW File
panel_3 = Panel("https://energyplus-weather.s3.amazonaws.com/north_and_central_america_wmo_region_4/USA/CA/USA_CA_Los.Angeles.722950_TMY2/USA_CA_Los.Angeles.722950_TMY2.zip")
downloadepw = LBDownloadWeather(weather_URL=panel_3)  # -> epw_file, stat_file, ddy_file; plug-in component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

model = HBModel(rooms=flatten(rotate))  # -> report, model; plug-in component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
path = FilePath("/Users/timofeddern/Library/CloudStorage/SynologyDrive-Documents/02_ETH/02_CECD/E02/CAN_AB_Calgary-Springbank.AP.718600_TMYx.epw")
importepw = LBImportEPW(epw_file=path)  # -> location, dry_bulb_temperature, dew_point_temperature, relative_humidity, wind_speed, wind_direction, direct_normal_rad, diffuse_horizontal_rad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; plug-in component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
vizbytype = HBVisualizeByType(hb_objs=rotate)  # -> walls, interior_walls, roofs, ceilings, exterior_floors, interior_floors, air_walls, apertures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; plug-in component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

deconstrprogram = HBDeconstructProgramType(program=panel)  # -> people, lighting, electric_equip, gas_equip, hot_water, infiltration, ventilation, setpoint; plug-in component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
decnstrpeople = HBDeconstructPeople(people=deconstrprogram.people)  # -> name, ppl_per_area, occupancy_sch, activity_sch; plug-in component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
schtodata = HBScheduleToData(schedule=decnstrpeople.occupancy_sch)  # -> data; plug-in component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

# ---- group: Run Me!
toggle = BooleanToggle(True)

# ----
modeltoosm = HBModelToOSM(model=model.model, epw_file=path, sim_par=simpar, write=toggle, run=toggle)  # -> report, jsons, osw, osm, idf, sql, zsz, rdd, html; plug-in component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
xdata = LBDeconstructData(data=importepw.relative_humidity)  # -> header, values; plug-in component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
xdata_2 = LBDeconstructData(data=importepw.dry_bulb_temperature)  # -> header, values; plug-in component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
panel_4 = Panel(["Outdoor RelHumidity", xdata.values])
panel_5 = Panel(["Outdoor Temperature", xdata_2.values])
roomcomfortresult = HBReadRoomComfortResult(sql=modeltoosm.sql)  # -> oper_temp, air_temp, rad_temp, rel_humidity, unmet_heat, unmet_cool; plug-in component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
xdata_3 = LBDeconstructData(data=roomcomfortresult.oper_temp)  # -> header, values; plug-in component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
panel_6 = Panel(["Operative Temperature", xdata_3.values])
xdata_4 = LBDeconstructData(data=roomcomfortresult.rel_humidity)  # -> header, values; plug-in component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
panel_7 = Panel(["Operative RelHumidity", xdata_4.values])

psychrometricchart = LBPsychrometricChart(
    temperature=roomcomfortresult.oper_temp,
    rel_humidity=roomcomfortresult.rel_humidity,
    base_pt="40, -150, 0",
    data=schtodata,
    statement="a > 0.2")  # -> report, title, temp_lines, rh_lines, hr_lines, enth_wb_lines, mesh, legend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; plug-in component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
pmv_polygon = LBPMVPolygon(psych_chart=psychrometricchart.psych_chart)  # -> report, total_comfort, total_comf_data, polygon_names, polygon_comfort, polygon_data, comfort_poly, strategy_poly; plug-in component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
total_comfort_time = Panel(pmv_polygon.total_comfort)

hourlyplot = LBHourlyPlot(
    data=flatten([roomcomfortresult.unmet_heat, roomcomfortresult.unmet_cool, roomcomfortresult.oper_temp]),
    base_pt="40, 300, 0")  # -> report, mesh, legend, borders, labels, title, vis_set; plug-in component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
